# Grasshopper definition gh-ground-truth.ghx (Grasshopper 1.0.7)
# plug-ins: Docofossor

# ---- group: sandbox visualization
# Dimension
list = ValueList({"real": 0, "fake": 1}, selected="fake")
sandbox_real = Brep(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)
sandbox_fake = Brep(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)
filter = StreamFilter(Gate=list, Stream0=sandbox_real, Stream1=sandbox_fake)
preview = CustomPreview(Geometry=filter, Material=ColourSwatch(SwatchColor=RGB(117, 117, 117)))

# ----
canvas = GhPythonScript()  # -> out, offset_dist, c_bounds, canvas
# ---------- canvas: Python ----------
# LIBRARIES
import ghpythonlib.treehelpers as th
import Rhino.Geometry as rg
import math as m

# hard corded values
fig_size = 256
tolerance = 10
hm_xbounds = [17, 1152]
hm_ybounds = [-22, -751]
hm_zbounds = [0, 130]

# offset distance from the edge of sandbox
offset_dist = ((fig_size * m.sqrt(2)) / 2) + tolerance

# bounds for drawing area
c_xbounds = [17+offset_dist, 1152-offset_dist]
c_ybounds = [-22-offset_dist, -751+offset_dist]
c_zbounds = [0, 130]
c_bounds = [c_xbounds, c_ybounds, c_zbounds]
c_bounds = th.list_to_tree(c_bounds)

# draw canvas
xint = rg.Interval(c_xbounds[0], c_xbounds[1])
yint = rg.Interval(c_ybounds[0], c_ybounds[1])
plane = rg.Plane(rg.Point3d(0,0,130), rg.Vector3d.XAxis, rg.Vector3d.YAxis)
canvas = rg.Rectangle3d(plane, xint, yint)
# ---------- end canvas ----------
canvas_2 = Geometry(canvas.canvas)

# ---- group: random
seed = Slider(31, range=1..50)
# Design
design = GhPythonScript(c_bounds=canvas.c_bounds, num_crv=Slider(20, range=1..50), seed=seed)  # -> out, c_toolpaths, gh_toolpaths; inputs c_bounds: tree of Int32, num_crv: Int32, seed: Int32
# ---------- design: Python ----------
import ghpythonlib.treehelpers as th
import compas_ghpython as cgh
import compas.geometry as cg
import random as r
import math as m


def generate_toolpaths(c_bounds, num_crv, seed):
    xbounds = c_bounds[0]
    ybounds = c_bounds[1]
    zbounds = c_bounds[2]
    lbounds = [30, 150]
    
    toolpaths = []
    for i in range(num_crv):
        x_coord = r.randint(xbounds[0], xbounds[1])
        y_coord = r.randint(ybounds[1], ybounds[0])
        z_coord = 130
        pt = cg.Point(x_coord, y_coord, z_coord)
        
        delta = r.random()
        length = r.randint(lbounds[0], lbounds[1])
        vec = cg.Vector(-length, 0, 0)
        
        T = cg.Translation.from_vector(vec)
        pt_end = pt.transformed(T)
        
        pl = cg.Polyline([pt, pt_end])
        
        # set angle
        angle = r.randint(0, 180)
        
        toolpaths.append(pl)
    return toolpaths


def draw_toolpaths(c_toolpaths):
    gh_toolpaths = []
    for tp in c_toolpaths:
        artist = cgh.artists.PolylineArtist(tp)
        pl = artist.draw()[0]
        gh_toolpaths.append(pl)
    return gh_toolpaths

c_bounds = th.tree_to_list(c_bounds)
c_toolpaths = generate_toolpaths(c_bounds, num_crv, seed)
gh_toolpaths = draw_toolpaths(c_toolpaths)
# ---------- end design ----------
crv = Curve(design.gh_toolpaths)

# ---- group: proxy
initiate_proxy = Button()
start_proxy = BooleanToggle(False)
activate = BooleanToggle(False)

# ---- group: save
design_iteration = Panel("0")
export = Button()

# ---- group: scanning
scan = BooleanToggle(False)

# ----
panel = Panel("G:\Shared drives\2021_MAS\T3\Common Ground Control\01_data\02_demo\01_interactive-gh\01_data/scan_grid.asc")

# ---- group: grid
x_count = Slider(6, range=0..30)
y_count = Slider(3, range=0..30)
length = Slider(100, range=0..100)
angle = Slider(45, range=0..360)

boundary = BoundarySurfaces(Edges=canvas_2)
sdivide = DivideSurface(Surface=boundary, UCount=expr("x-1", x_count), VCount=expr("x-1", y_count))  # -> Points, Normals, Parameters
flatten = FlattenTree(Tree=sdivide.Points, Path="{0}")

division = Division(A=length, B=2)
X = UnitX(Factor=1)
neg = Negative(Value=X)
line = LineSDL(Start=flatten, Direction=X, Length=division)
line_2 = LineSDL(Start=flatten, Direction=neg, Length=division)
join = JoinCurves(Curves=[line, line_2], Preserve=False)

rad = Radians(Degrees=angle)
xy = XYPlane(Origin=flatten)
rotate = Rotate(Geometry=join, Angle=rad, Plane=xy)  # -> Geometry, Transform

crv_2 = Curve(rotate.Geometry)

# ---- group: length chech / translator
list_2 = ValueList({"random": 0, "grid": 1}, selected="grid")
filter_2 = StreamFilter(Gate=list_2, Stream0=crv, Stream1=crv_2)
translatot = GhPythonScript(gh_crv=filter_2)  # -> compas_crvs, ghs; inputs gh_crv: list of Curve
# ---------- translatot: Python ----------
from compas_ghpython.artists import PolylineArtist
import compas.geometry as cg
import Rhino.Geometry as rg

rg.Polyline.PointAt

seg = 100
step = 1 / (100-1)
interval = rg.Interval(0, 1)


pls = []
for c in gh_crv:
    c.Domain = interval
    
    pts = []
    for i in range(seg):
        param = i * step
        p = c.PointAt(param)
        pts.append(p)
    pl = cg.Polyline(pts)
    pls.append(pl)
compas_crvs = pls


# visualize
ghs = []
for pl in pls:
    art = PolylineArtist(pl)
    gh = art.draw()
    ghs.append(gh[0])
# ---------- end translatot ----------

# ---- group: prediction
depth = Slider(0, range=0..130)
prediction = BooleanToggle(False)
adaptive = BooleanToggle(True)
compas_toolpaths = Data(translatot.compas_crvs)

# ----
ground_truth = GhPythonScript(
    activate=activate,
    start_proxy=start_proxy,
    initialise_proxy=initiate_proxy,
    scan_sandbox=scan,
    toolpaths=compas_toolpaths,
    prediction=prediction,
    adaptive=adaptive,
    iteration=design_iteration,
    export=export)  # -> out, f_scan, f_pred, tp; inputs activate: Boolean, start_proxy: Boolean, initialise_proxy: Boolean, scan_sandbox: Boolean, toolpaths: list, prediction: Boolean, adaptive: Boolean, iteration: Int32, export: Boolean
# ---------- ground_truth: Python ----------
from compas_ghpython import unload_modules
from compas_ghpython import artists
unload_modules('groundtruth')
from compas.rpc import Proxy

interface = None

if activate:
    interface = Proxy('groundtruth.interactive.interface')
    if initialise_proxy:
        interface.restart_server()
    if start_proxy:
        interface.start_server()
    else:
        interface.stop_server()
        
        
if interface and start_proxy:
    if scan_sandbox:
        f_scan = interface.scan_sandbox()
    if prediction:
        f_pred, tp = interface.prediction(toolpaths, adaptive)
    if export:
        interface.export_design(tp, iteration)
# ---------- end ground_truth ----------
# Prediction
messages = Panel(ground_truth.out)

# ---- group: toolpaths visualization
list_3 = ValueList({"points": 0, "frames": 1, "polyline": 2}, selected="polyline")
dam = DataDam(DataTp=ground_truth.tp, BufferDelay=10000000, BufferMode=0)
tp_visualise = GhPythonScript(tp=dam, vis_type=list_3)  # -> vis; inputs tp: list
# ---------- tp_visualise: Python ----------
import ghpythonlib.treehelpers as th
import Rhino.Geometry as rg
import compas.geometry as cg
from compas_ghpython.artists import PointArtist, FrameArtist, PolylineArtist

def remapValue(v, ori_Min, ori_Max, targetMin, targetMax):
    rv = ((v-ori_Min)/(ori_Max-ori_Min))*(targetMax-targetMin)+targetMin
    return rv

if tp[0] != None:
    frames_tree = []
    pts_tree = []
    pls_list = []
    for t in tp:
        frames_list = []
        pts_list = []
        for f in t:
            f_mirror = f.copy()
            f_mirror.point.y *= (-1)
            # move frame
            framefrom = cg.Frame(cg.Point(0, 0, 0),
                                 cg.Vector.Xaxis(),
                                 cg.Vector.Yaxis())
            frameto = cg.Frame(cg.Point(17,
                                        -22,
                                        0),
                               cg.Vector.Xaxis(),
                               cg.Vector.Yaxis())
            T = cg.Transformation.from_frame_to_frame(framefrom, frameto)
            f_moved = f_mirror.transformed(T)
            # remap z_values
            f_moved.point.z = remapValue(f_moved.point.z, 0, 130, 130, 0)
            # call artist
            artist = FrameArtist(f_moved)
            plane = artist.draw()
            frames_list.append(plane)
            pts_list.append(plane.Origin)
        # frames
        frames_tree.append(frames_list)
        # pts
        pts_tree.append(pts_list)
        # polyline
        pl = rg.Polyline(pts_list)
        pls_list.append(pl)
    
    if vis_type == 0:
        vis = pts_tree
        vis = th.list_to_tree(vis)
    elif vis_type == 1:
        vis = frames_tree
        vis = th.list_to_tree(vis)
    elif vis_type == 2:
        vis = pls_list
# ---------- end tp_visualise ----------
geo = Geometry(tp_visualise)
preview_2 = CustomPreview(Geometry=geo, Material=ColourSwatch(SwatchColor=RGB(0, 64, 255)))

# ---- group: height map visualization
dam_2 = DataDam(DataA=ground_truth.f_scan, BufferDelay=10000000, BufferMode=0)
dam_3 = DataDam(DataF=ground_truth.f_pred, BufferDelay=10000000, BufferMode=0)
list_4 = ValueList({"scan": 0, "prediction": 1, "test scan": 2}, selected="scan")
merge = Merge(Data1=dam_2, Data2=dam_3, Data3=graft(panel))
item = ListItem(List=merge, Index=list_4, Wrap=True)
dfimportasc = ImportASC(F=item)
dfgridmesh = GridMesh(Df=dfimportasc)
coloring_mesh = ColoringMesh(mesh=dfgridmesh)
mesh = Mesh(coloring_mesh)

# ==== cluster ColoringMesh
mesh = ClusterInput()
mesh_2 = Mesh(mesh)
demesh = DeconstructMesh(Mesh=mesh_2)  # -> Vertices, Faces, Colours, Normals
pdecon = Deconstruct(Point=demesh.Vertices)  # -> XComponent, YComponent, ZComponent
bnd = Bounds(Numbers=pdecon.ZComponent)
remap = RemapNumbers(Value=pdecon.ZComponent, Source=bnd, Target=Domain(0, 1))  # -> Mapped, Clipped
frgb = ColourRGBF(Alpha=1, Red=remap.Mapped, Green=remap.Mapped, Blue=remap.Mapped)
mcol = MeshColours(Mesh=mesh_2, Colours=frgb)
M = ClusterOutput(mcol)
